# Grasshopper definition shell_2.gh (Grasshopper 1.0.7)

# ---- group: Height
height = GetInteger(
    Slider(70, range=0..100),
    {"70"}, selected=[],
    AtLeast=1,
    AtMost=1,
    Maximum=2147483647,
    Minimum=-2147483648,
    TreeAccess=False)

# ---- group: Bend
bend = GetInteger(
    Slider(5, range=0..50),
    {"5"}, selected=[],
    AtLeast=1,
    AtMost=1,
    Maximum=2147483647,
    Minimum=-2147483648,
    Prompt="0=Curve, >0 Origami Bending ",
    TreeAccess=False)

# ---- group: Parts
parts = GetInteger(
    Slider(11, range=0..20),
    {"11"}, selected=[],
    AtLeast=1,
    AtMost=1,
    Maximum=2147483647,
    Minimum=-2147483648,
    Prompt="Number of Subdivisions of the Shell",
    TreeAccess=False)

# ----
negative = Negative(Value=height)
multiplication = Multiplication(A=negative, B=-1)
construct_point = ConstructPoint(XCoordinate=0, YCoordinate=negative, ZCoordinate=0)
construct_point_2 = ConstructPoint(XCoordinate=negative, YCoordinate=negative, ZCoordinate=0)
construct_point_3 = ConstructPoint(XCoordinate=multiplication, YCoordinate=negative, ZCoordinate=multiplication)
nurbs_curve = NurbsCurve(Vertices=[construct_point_2, construct_point, construct_point_3], Degree=Slider(2, range=0..10), Periodic=False)  # -> Curve, Length, Domain
rotate = Rotate(Geometry=nurbs_curve.Curve, Angle=degrees(Slider(180, range=0..1000)), Plane=PlaneXY(0, 0, 0))  # -> Geometry, Transform
flip_curve = FlipCurve(Curve=rotate.Geometry)  # -> Curve, Flag
loft = Loft(
    Curves=[nurbs_curve.Curve, flip_curve.Curve],
    Options={Adjust=False, Closed=False, LoftEnds=0, LoftSimp=0, LoftType=0, Rebuild=10, Refit=0.01})
divide_surface = DivideSurface(Surface=loft, UCount=parts, VCount=parts)  # -> Points, Normals, Parameters
nurbs_curve_2 = NurbsCurve(Vertices=divide_surface.Points, Degree=Slider(2, range=0..10), Periodic=False)  # -> Curve, Length, Domain
list_length = ListLength(List=divide_surface.Normals)
division = Division(A=list_length, B=Slider(2, range=0..10))
list_item = ListItem(List=divide_surface.Normals, Index=division, Wrap=True)
unit_vector = UnitVector(Vector=list_item)
amplitude = Amplitude(Vector=unit_vector, Amplitude=bend)
panel = Panel("""0
1""")
flatten_tree = FlattenTree(Tree=amplitude, Path="{0}")
list_length_2 = ListLength(List=flatten_tree)
repeat_data = RepeatData(Data=panel, Length=list_length_2)
multiplication_2 = Multiplication(A=flatten_tree, B=repeat_data)  # -> graft(Result)
move = Move(Geometry=nurbs_curve_2.Curve, Motion=multiplication_2)  # -> Geometry, Transform
flatten_tree_2 = FlattenTree(Tree=move.Geometry, Path="{0}")
control_points = ControlPoints(Curve=flatten_tree_2)  # -> simplify(Points), Weights, Knots
polyline = PolyLine(Vertices=control_points.Points, Closed=False)
explode = Explode(Curve=polyline, Recursive=True)  # -> Segments, Vertices
curve = Curve(explode.Segments)
flip_matrix = FlipMatrix(Data=curve)
shift_list = ShiftList(List=flip_matrix, Shift=1, Wrap=True)
cull_index = CullIndex(List=shift_list, Indices=-1, Wrap=True)
ruled_surface = RuledSurface(CurveA=flip_matrix, CurveB=cull_index)  # -> simplify(Surface)
number_slider = Slider(1, range=0..1)
mesh_surface = MeshSurface(Surface=ruled_surface, UCount=number_slider, VCount=number_slider, Overhang=True, Equalize=False)
triangulate = Triangulate(Mesh=mesh_surface)  # -> Mesh, Count
face_boundaries = FaceBoundaries(Mesh=triangulate.Mesh)
face_normals = FaceNormals(Mesh=triangulate.Mesh)  # -> Centers, Normals
panel_2 = Panel("""True
False""")
unit_vector_2 = UnitVector(Vector=face_normals.Normals)
dispatch = Dispatch(List=face_boundaries, DispatchPattern=panel_2)  # -> ListA, ListB
amplitude_2 = Amplitude(Vector=unit_vector_2, Amplitude=1)
construct_point_4 = ConstructPoint(XCoordinate=0, YCoordinate=0, ZCoordinate=0)
distance = Distance(PointA=amplitude_2, PointB=construct_point_4)
larger_than = LargerThan(FirstNumber=distance, SecondNumber="0")  # -> LargerThan, OrEqualTo
cull_pattern = CullPattern(List=amplitude_2, CullPattern=larger_than.LargerThan)
curve_2 = Curve(dispatch.ListB)
uservalue = Text()
extrude = Extrude(Base=face_boundaries, Direction=cull_pattern)
boundary_surfaces = BoundarySurfaces(Edges=flatten(curve_2))
mesh_brep = MeshBrep(
    Brep=boundary_surfaces,
    Settings={GridMaxCount=0, GridMinCount=16, JaggedSeams=False, MaxEdgeLength=0, MinEdgeLength=0.0001, MinTolerance=0, Refine=True, RefineAngle=0, RelativeTolerance=0.65, SimplePlanes=True, Tolerance=0})
mesh_brep_2 = MeshBrep(
    Brep=extrude,
    Settings={GridMaxCount=0, GridMinCount=16, JaggedSeams=False, MaxEdgeLength=0, MinEdgeLength=0.0001, MinTolerance=0, Refine=True, RefineAngle=0, RelativeTolerance=0.65, SimplePlanes=True, Tolerance=0})
bounding_box = BoundingBox(Content=mesh_brep, Plane=PlaneXY(0, 0, 0), UnionBox=True)  # -> Box, Box_2
mesh_colours = MeshColours(Mesh=mesh_brep, Colours=ColourSwatch(SwatchColor=RGB(217, 247, 255)))
deconstruct_brep = DeconstructBrep(Brep=bounding_box.Box)  # -> Faces, Edges, Vertices
area = Area(Geometry=mesh_colours)  # -> Area, Centroid
list_item_2 = ListItem(List=deconstruct_brep.Faces, Index=0, Wrap=True)  # -> Item, Item1, Item2, Item3, Item4
userkey = Text("area")
geometry = Geometry(list_item_2.Item4)
c_script = CSharpScript(geometry=mesh_colours, userKey=userkey, userValue=area.Area)  # -> out, geoWithUserString; inputs geometry: GeometryBase, userKey: String, userValue: String
# ---------- c_script: C# ----------
    geometry.SetUserString(userKey, userValue);
   geoWithUserString = geometry;
# ---------- end c_script ----------
mesh_brep_3 = MeshBrep(
    Brep=geometry,
    Settings={GridMaxCount=0, GridMinCount=16, JaggedSeams=False, MaxEdgeLength=0, MinEdgeLength=0.0001, MinTolerance=0, Refine=True, RefineAngle=0, RelativeTolerance=0.65, SimplePlanes=True, Tolerance=0})
geometry_2 = Geometry(flatten(mesh_brep_2))
geometry_3 = Geometry(c_script.geoWithUserString)
geometry_4 = Geometry(mesh_brep_3)
context_bake = ContextBake(Geometry=geometry_4)
context_bake_2 = ContextBake(Geometry=geometry_2)
context_bake_3 = ContextBake(Geometry=geometry_3)
